# Grasshopper definition brick_masonry.ghx (Grasshopper 1.0.7)
# Synthesized by Antigravity Grasshopper Toolkit

columns = Slider(20, range=5..50)
rows = Slider(10, range=2..30)
jitter = Slider(0.25, range=0..1)
carelessrange = CarelessRange(Errancy=jitter)  # -> Range, Interval
slingshot = SlingshotAllocator(Data=carelessrange.Range)
symmetricdomain = SymmetricDomain(Length=slingshot)
python = GhPythonScript(cols=columns, rows=rows, jitter_vals=symmetricdomain)  # -> brick_boxes, centers
# ---------- python: Python ----------
# Inputs: cols, rows, jitter_vals
# Outputs: brick_boxes, centers
import Rhino.Geometry as rg

brick_boxes = []
centers = []
w, h, d = 200.0, 65.0, 100.0

for r in range(int(rows)):
    offset = (w * 0.5) if (r % 2 == 1) else 0.0
    for c in range(int(cols)):
        idx = (r * int(cols) + c) % len(jitter_vals) if jitter_vals else 0
        rot = jitter_vals[idx] if jitter_vals else 0.0
        pt = rg.Point3d(c * (w + 10.0) + offset, 0, r * (h + 10.0))
        box = rg.Box(rg.Plane.WorldXY, rg.Interval(pt.X - w/2, pt.X + w/2),
                     rg.Interval(pt.Y - d/2, pt.Y + d/2),
                     rg.Interval(pt.Z, pt.Z + h))
        brick_boxes.append(box)
        centers.append(pt)
# ---------- end python ----------
