# Grasshopper definition spacesyntax.ghx (Grasshopper 1.0.7)
# Synthesized by Antigravity Grasshopper Toolkit

center = Center()  # -> Center, Dimension
adjacency = TopologyOfAdjacencies()
reconstnet = ReconstructTopology(PointsOptional=center.Center)  # -> NodeNode, EdgeNode, Points, Lines
sourcenode = Slider(0, range=0..20)
depth = Slider(6, range=1..15)
spacesyntax = SpaceSyntax(NodeNode=reconstnet.NodeNode, Source=sourcenode, Depth=depth)  # -> NodeSpaceSyntax, ConnectionSpaceSyntax
edge = Normalizer()
