# Grasshopper definition viewport_pip.ghx (Grasshopper 1.0.7)
# Synthesized by Antigravity Grasshopper Toolkit

azimuth = Slider(45, range=0..360)
elevation = Slider(30, range=-89..89)
distance = Slider(150, range=10..1000)
lens_focal_length = Slider(50, range=14..200)
panel = Panel()
panel_2 = Panel()
fps = Slider(15, range=1..60)
c_script = CSharpScript(View_name=panel, Azim=azimuth, Elev=elevation, Dist=distance, Lens=lens_focal_length, Display_mode=panel_2)  # -> Cam_pt, Target_pt, Cam_dir, Frustum, Status
c_script_2 = CSharpScript(View_name=panel, Fps=fps, Display_mode=panel_2)  # -> Is_open, Active_view, Resolution, Status
panel_3 = Panel(In=c_script.Status)
panel_4 = Panel(In=c_script_2.Status)
